# Grasshopper definition algo.gh (Grasshopper 1.0.8)
# plug-ins: RhinoCodePluginGH

number_slider = Slider(3, range=3..20)
twist_angle = Slider(45, range=0..45)
angle = Slider(1, range=1..2.25)
number_slider_2 = Slider(3, range=3..20)
angle_2 = Slider(2.25, range=1..2.25)
angle_3 = Slider(1, range=1..2.25)
twist_angle_2 = Slider(45, range=0..45)
twist_angle_3 = Slider(45, range=0..45)
vec = Vector(Vector(-59.62386765, 57.34406689, 0))
vec_2 = Vector(Vector(55.5459909, 58.1770365, 0))
vec_3 = Vector(Vector(-0.2234905198, 56.06539375, 0))

py3 = Python3Script(x=Slider(10, range=3..20), y=angle, z=twist_angle)  # -> out
# ---------- py3: Python ----------
# Requirements: clr
import Rhino
import json
import clr

# Add references for .NET namespaces
# needed to convert System.Decimal to float
clr.AddReference("System")
clr.AddReference("System.Globalization")
from System import Decimal
from System.Globalization import CultureInfo

# Initialize an empty dictionary to store data for each slider
sliders_data = {}

# Iterate through all input parameters
for idx, input_param in enumerate(ghenv.Component.Params.Input):

    slider = input_param.Sources[0]

    # Convert System.Decimal to Python float using .NET's ToDouble() method
    Min = Decimal.ToDouble(slider.Slider.Minimum)
    Max = Decimal.ToDouble(slider.Slider.Maximum)
    Value = Decimal.ToDouble(slider.Slider.Value)

    # Calculate the precision dynamically
    precision_str = f"{Value:.12f}".rstrip("0").split(".")[1]
    precision = len(precision_str)
    Step_size = 10 ** -precision

    Range = (Max - Min) / Step_size if Step_size > 0 else 0

    # Store data for this slider in the dictionary
    sliders_data[f"Slider_{idx}"] = {
        "Value": Value,
        "Min": Min,
        "Max": Max,
        "Step Size": Step_size,
        "Range": Range
    }

# Convert the sliders_data dictionary to a JSON string without line breaks
sliders_data_json = json.dumps(sliders_data, separators=(", ", ":"))

# Print the JSON string
print(sliders_data_json)
# ---------- end py3 ----------
panel = Panel(py3)

cluster = Cluster(S=6, F=angle, position=vec, A=degrees(twist_angle))
cluster_2 = Cluster(S=number_slider_2, F=angle_3, position=vec_2, A=degrees(twist_angle_2))
cluster_3 = Cluster(S=number_slider, F=angle_2, position=vec_3, A=degrees(twist_angle_3))
py3_2 = Python3Script(x=number_slider, y=angle_2, z=twist_angle_3)  # -> out; same code as py3
py3_3 = Python3Script(x=number_slider_2, y=angle_3, z=twist_angle_2)  # -> out; same code as py3
panel_2 = Panel("VOTING INPUT")
design_1_voting = Slider(6, range=0..20)
design_2_voting = Slider(20, range=0..20)
design_3_voting = Slider(20, range=0..20)
dup = DuplicateData(Data=py3, Number=design_1_voting, Order=True)
dup_2 = DuplicateData(Data=py3_3, Number=design_3_voting, Order=True)
dup_3 = DuplicateData(Data=py3_2, Number=design_2_voting, Order=True)
panel_3 = Panel(dup)
D = Panel([panel_3, dup_3, dup_2])
lng = ListLength(List=D)
py3_4 = Python3Script(x=lng)  # -> out
# ---------- py3_4: Python ----------
import random

r = random.randint(0, x)
print(r)
# ---------- end py3_4 ----------
py3_5 = Python3Script(x=lng)  # -> out; same code as py3_4
py3_6 = Python3Script(x=lng)  # -> out; same code as py3_4
py3_7 = Python3Script(x=lng)  # -> out; same code as py3_4
py3_8 = Python3Script(x=lng)  # -> out; same code as py3_4
py3_9 = Python3Script(x=lng)  # -> out; same code as py3_4
item = ListItem(List=D, Index=py3_5, Wrap=True)
item_2 = ListItem(List=D, Index=py3_4, Wrap=True)
item_3 = ListItem(List=D, Index=py3_8, Wrap=True)
item_4 = ListItem(List=D, Index=py3_6, Wrap=True)
item_5 = ListItem(List=D, Index=py3_9, Wrap=True)
item_6 = ListItem(List=D, Index=py3_7, Wrap=True)
panel_4 = Panel(item_2)
panel_5 = Panel(item)
panel_6 = Panel("MUTATION CONFIG")
mutation_probability = Slider(20, range=0..100)
mutation_range = Slider(10, range=0..100)
panel_7 = Panel(item_3)
panel_8 = Panel(item_4)
panel_9 = Panel(item_5)
panel_10 = Panel(item_6)
py3_10 = Python3Script(parent_1=panel_5, parent_2=panel_4, mutation_probability=mutation_probability, mutation_range=mutation_range)  # -> out, a, b, c
# ---------- py3_10: Python ----------
import random
import json


data1 = json.loads(parent_1)
data2 = json.loads(parent_2)

child = []
num_inputs = len(data1)

# Loop to process each input key dynamically
for i in range(num_inputs):
    key = f"Slider_{i}"
    
    # step_size1 = data1[key]["Step Size"]
    min1 = data1[key]["Min"]
    max1 = data1[key]["Max"]
    range1 = data1[key]["Range"]

    value = data1[key]["Value"] if random.choice([True, False]) else data2[key]["Value"]

    if random.randint(1, 100) < mutation_probability:
        deviation = (range1 / 100) * random.randint(0, mutation_range)
        value = value + deviation if random.choice([True, False]) else value - deviation
    if value < min1:
        value = min1
    elif value > max1:
        value = max1
    child.append(str(value))

for i, value in enumerate(child):
    exec(f"{chr(97 + i)} = {value}")

child = ",".join(child)
print(child)
# ---------- end py3_10 ----------
py3_11 = Python3Script(parent_1=panel_7, parent_2=panel_8, mutation_probability=mutation_probability, mutation_range=mutation_range)  # -> out, a, b, c; same code as py3_10
py3_12 = Python3Script(parent_1=panel_9, parent_2=panel_10, mutation_probability=mutation_probability, mutation_range=mutation_range)  # -> out, a, b, c; same code as py3_10
panel_11 = Panel(py3_10.out)
panel_12 = Panel(py3_11.out)
panel_13 = Panel(py3_12.out)
vec_4 = Vector(Vector(53.19676557, -0.1945631876, 0))
vec_5 = Vector(Vector(-0.2485473088, -2.257786579, 0))
vec_6 = Vector(Vector(-57.07619961, -2.550742856, 0))
cluster_4 = Cluster(S=py3_10.a, F=py3_10.b, position=vec_6, A=degrees(py3_10.c))
cluster_5 = Cluster(S=py3_11.a, F=py3_11.b, position=vec_5, A=degrees(py3_11.c))
cluster_6 = Cluster(S=py3_12.a, F=py3_12.b, position=vec_4, A=degrees(py3_12.c))

# ==== cluster Cluster
hight = Panel("20")
floor_thickness = Panel("3")
ground_radius = Panel("10")
S = ClusterInput()
polygon = Polygon(Plane=PlaneXY(0, 0, 0), Radius=ground_radius, Segments=S, FilletRadius=0)  # -> Polygon, Length
Z = UnitZ(Factor=floor_thickness)
Z_2 = UnitZ(Factor=floor_thickness)
rev = Reverse(Vector=Z_2)
move = Move(Geometry=polygon.Polygon, Motion=Z)  # -> Geometry, Transform
Z_3 = UnitZ(Factor=hight)
F = ClusterInput()
scale = Scale(Geometry=move.Geometry, Center=Point(0, 0, 0), Factor=F)  # -> Geometry, Transform
srf = Surface(move.Geometry)
move_2 = Move(Geometry=scale.Geometry, Motion=Z_3)  # -> Geometry, Transform
A = ClusterInput()
extr = Extrude(Base=srf, Direction=rev)
rotate = Rotate(Geometry=move_2.Geometry, Angle=degrees(A), Plane=PlaneXY(0, 0, 0))  # -> Geometry, Transform
position = ClusterInput()
loft = Loft(
    Curves=[rotate.Geometry, move.Geometry],
    Options={Adjust=False, Closed=False, LoftEnds=0, LoftSimp=0, LoftType=0, Rebuild=10, Refit=0.01})
vec = Vector(position)
move_3 = Move(Geometry=extr, Motion=vec)  # -> Geometry, Transform
move_4 = Move(Geometry=loft, Motion=vec)  # -> Geometry, Transform
